% Simulink data dictionary data_dictionary1.sldd

T_env = 293.15
T_steam = 403.15
flow_final = 0.18
p_env = 101.325
p_init = 101.325
pipe_cross_sectional_area1 = 20.2683
pipe_cross_sectional_area2 = 20.2683
pipe_cross_sectional_area3 = 20.2683
pipe_hydraulic_diameter1 = 5.08
pipe_hydraulic_diameter2 = 5.08
pipe_hydraulic_diameter3 = 5.08
pipe_length1 = 1
pipe_length2 = 1
pipe_length3 = 1
specific_heat1 = 447
specific_heat2 = 447
specific_heat3 = 447
specific_heat4 = 447
specific_heat5 = 447
thermal_mass1 = 1
thermal_mass2 = 1
thermal_mass3 = 1
thermal_mass4 = 1
thermal_mass5 = 1
u_steam_init = 0
u_volts_fan_init = 1
u_volts_heater_init = 0
phi_init = 0.6
phi_env = 0.6
T_init = 293.15
flow_init = 0
Ts = 0.1
stop_time = 8000
T_final = 310
ecr_wt = 100000
control_horizon = 1
y2_wt = 1000000000
prediction_horizon = 100
y1_wt = 100000000
u1p_wt = 1.0e-5
u2p_wt = 1.0e-5
u1_wt = 0
u2_wt = 0